# Grasshopper definition example.gh (Grasshopper 0.9.76)
# plug-ins: Autocad, PathTool

pop3d = Populate3D(Region={Plane=PlaneXY(0, 0, 0), X=Domain(0, 10), Y=Domain(0, 10), Z=Domain(0, 2)}, Count=100, Seed=1)
pdecon = Deconstruct(Point=pop3d)  # -> XComponent, YComponent, ZComponent
concat = Concatenate(FragmentA=pdecon.XComponent, FragmentB=pdecon.YComponent, FragmentC=pdecon.ZComponent, JoinSeparator=",")
join = TextJoin(Text=concat, Join=" ")
concat_2 = Concatenate(FragmentA="line", FragmentB=join, FragmentC=" ", JoinSeparator=" ")
pathtool = PathTool(RelPath="out.dwg")
nickname = Autocad(
    AutocadPath="C:\Program Files\Autodesk\AutoCAD 2017\accoreconsole.exe",
    Script=concat_2,
    OutFile=pathtool,
    Run=Toggle(True))
